# Dynamo graph JsonDataSample.dyn (Dynamo 2.0.0.4654)

# group: Read.FromJsonFile
# note: This node will read a valid json file and return an object, following same rules as Parse.JsonString.
file_path = Filename(".\inputJsonFileSample.json")
fromJsonFile = JsonData.Utilities.Read.FromJsonFile(filepath=file_path)
watch = Watch(fromJsonFile)

# group: Example of modifying attributes and adding new ones
code_block = CodeBlock(jsonObjects=watch) { jsonObjects; "id"; }
getValueByKey = JsonObject.GetValueByKey(jsonObject=code_block.jsonObjects, keys=code_block.out1, Nesting=true, Option="None")
code_block_2 = CodeBlock(id=getValueByKey) { "ID-" + id; }
now = DateTime.Now()
count = List.Count(list=code_block.jsonObjects)
ofRepeatedItem = List.OfRepeatedItem(item=now, amount=count)
create = List.Create(item0=code_block_2, item1=ofRepeatedItem)
transpose = List.Transpose(lists=create)
code_block_3 = CodeBlock(ListOfJsonObjects=code_block.jsonObjects, ListOfvalues=transpose) { ListOfJsonObjects; ListOfvalues; }
code_block_4 = CodeBlock { ["id", "modified"]; }
add = JsonObject.Add(jsonObject=code_block_3.ListOfJsonObjects, keys=code_block_4, values=code_block_3.ListOfvalues, Nesting=true, Option="Update")
watch_2 = Watch(add)

# group: ToJsonFile
# note: This node will write the data inputed into a valid json file.
# If a list of JsonObjects is input, they will be serialized as a single array.
file_path_2 = Filename(".\outputJsonFileSample.json")
toJsonFile = JsonData.Utilities.Write.ToJsonFile(jsonObjects=watch_2, filepath=file_path_2)
watch_3 = Watch(toJsonFile)

# group: ParseJsonString - others
# note: If string not of previous two, it will try to convert the input to an object.
# If not possible, error will be thrown.
code_block_5 = CodeBlock { "1"; "3.1415926"; "string"; }
# note: If unfreezed, this will throw an error.
string = JsonData.Utilities.Parse.String(jsonString=code_block_5.out2)  # frozen
string_2 = JsonData.Utilities.Parse.String(jsonString=code_block_5.out1)
watch_4 = Watch(string_2)
string_3 = JsonData.Utilities.Parse.String(jsonString=code_block_5.out0)
watch_5 = Watch(string_3)

# group: Parse.JsonString - JsonObject format
# note: If the string matches the JsonObject format, a new instance will be returned
string_4 = StringInput("""{"name": "parsedObject01",
"id": 101}""")  # graph input
string_5 = JsonData.Utilities.Parse.String(jsonString=string_4)
watch_6 = Watch(string_5)

# group: ParseJsonString - List of JsonObjects
# note: If the string represents an array, it will be parsed as a List of JsonObjects
string_6 = StringInput("""[
{"name": "parsedObject02",
"id": 102},
{"name": "parsedObject03",
"id": 103}
]""")  # graph input
string_7 = JsonData.Utilities.Parse.String(jsonString=string_6)
watch_7 = Watch(string_7)

# group: JsonObject - Basic constructor
# note: A new JsonObject is creating by a given set of keys and values.
# - Keys can only be of type string only.
# - Values can be of any System type (string, int, double, etc.) as well as Autodesk.DesignScript, Revit and other JsonData objects.
code_block_6 = CodeBlock { oneKey = "firstKey"; anotherKey = "1"; "firstKey"; "nested.key"; }
create_2 = List.Create(item0=code_block_6.oneKey, item1=code_block_6.anotherKey, item2=code_block_6.out2, item3=code_block_6.out3)
code_block_7 = CodeBlock { stringValue= "string"; intValue = 1; origin= Autodesk.Point.ByCoordinates(); "nestedValue"; }
create_3 = List.Create(item0=code_block_7.stringValue, item1=code_block_7.intValue, item2=code_block_7.origin, item3=code_block_7.out3)
# note: If a key is already present at the JsonObject, JsonOptions control how to handle this exception:
# - None: throws the exception.
# - Update: replaces the existing value with the new one.
# - Combine: creates a list with the existing and new value.
byKeysAndValues = JsonObject.ByKeysAndValues(keys=create_2, values=create_3, Nesting=true, Option="Combine")
watch_8 = Watch(byKeysAndValues)

# group: JsonObject - Adding and Updating Attributes
# note: New attributes can be added by inputing sets of keys and values. If the given key is already present in any attribute, choosing the proper option will either update the value, combine them or throw and error.
code_block_8 = CodeBlock { ["nested.key", "firstKey", "temp"]; [3.1415926,"updated string", "temporary attribute"]; }
add_2 = JsonObject.Add(jsonObject=byKeysAndValues, keys=code_block_8.out0, values=code_block_8.out1, Nesting=true, Option="Update")
watch_9 = Watch(add_2)

# group: JsonObject - Size
# note: This node will the number of attributes present on the JsonObject.
size = JsonData.Elements.JsonObject.Size(jsonObject=watch_9)
watch_10 = Watch(size)

# group: JsonObject - Merging
# note: The Merge node will combine one JsonObject with one or multiple JsonObject. If duplicated keys, error will be thrown.
code_block_9 = CodeBlock { "name"; ["object01", "object02", "item03"]; }
byKeysAndValues_2 = JsonObject.ByKeysAndValues(keys=code_block_9.out0, values=code_block_9.out1, Nesting=true, Option="None", lacing=Longest)
code_block_10 = CodeBlock { "id"; [101, 102, 103]; }
byKeysAndValues_3 = JsonObject.ByKeysAndValues(keys=code_block_10.out0, values=code_block_10.out1, Nesting=true, Option="None", lacing=Longest)
merge = JsonObject.Merge(jsonObject=byKeysAndValues_2, others=byKeysAndValues_3, Nesting=true, Option="None", lacing=Longest)
watch_11 = Watch(merge)

# group: JsonObject - FilterByKeyAndValue (string)
# note: If value is of type string, it will test true if it contains the given value.
code_block_11 = CodeBlock { "name"; "obj"; }
filterByKeyAndValue = JsonData.Elements.JsonObject.FilterByKeyAndValue(jsonObjects=watch_11, key=code_block_11.out0, value=code_block_11.out1)
watch_12 = Watch(filterByKeyAndValue.in)
watch_13 = Watch(filterByKeyAndValue.out)

# group: JsonObject - FilterByKeyAndValue
# note: The FilterByKeyAndValue will filter out JsonObjects which doesn´t have the given value associated to the key, or that directly don´t have that key.
code_block_12 = CodeBlock { "id"; 102; }
filterByKeyAndValue_2 = JsonData.Elements.JsonObject.FilterByKeyAndValue(jsonObjects=watch_11, key=code_block_12.out0, value=code_block_12.out1)
watch_14 = Watch(filterByKeyAndValue_2.out)
watch_15 = Watch(filterByKeyAndValue_2.in)

# group: JsonObject - Get Value by Key
# note: ValueByKey node will return the value corresponding to the given key. If key not present on JsonObject, error will be thrown.
code_block_13 = CodeBlock { "name"; }
getValueByKey_2 = JsonObject.GetValueByKey(jsonObject=watch_11, keys=code_block_13, Nesting=true, Option="None")
watch_16 = Watch(getValueByKey_2)

# group: JsonObject - Keys
# note: This node will return a list of all keys present on the JsonObject.
keys = JsonData.Elements.JsonObject.Keys(jsonObject=watch_9)
watch_17 = Watch(keys)

# group: JsonObject - Values
# note: This node will return a list of all values present on the JsonObject.
values = JsonData.Elements.JsonObject.Values(jsonObject=watch_9)
watch_18 = Watch(values)

# group: JsonObject - Removing Attributes
# note: Any attribute can be removed from the JsonObject given its key. If key not present, error will be thrown.
code_block_14 = CodeBlock { "nested.key"; }
remove = JsonObject.Remove(jsonObject=add_2, keys=code_block_14, Nesting=true, Option="None")
watch_19 = Watch(remove)

# group: JsonObject From and To Dynamo Dictionary
code_block_15 = CodeBlock { {"dict": {"nested": "value"}}; }
byDictionary = JsonData.Elements.JsonObject.ByDictionary(dictionary=code_block_15)
watch_20 = Watch(byDictionary)
toDictionary = JsonData.Elements.JsonObject.ToDictionary(jsonObject=byDictionary)
watch_21 = Watch(toDictionary)
