# Dynamo graph helloWorld.dyn (Dynamo 1.3.2.2480)

code_block = CodeBlock { {"Hello","Hola", "Hallo", "Bonjour"}; {"World!", "Mundo!", "Welt!", "Monde!"}; }
byKeysAndValues = JsonData.Elements.JsonObject.ByKeysAndValues(code_block.out0, code_block.out1)
watch = Watch(byKeysAndValues)
